# Dynamo graph BIM-Estimator.dyn (Dynamo 0.8.1.1942)

categories = Categories("StructuralColumns")
all_elements_of_category = ElementsOfCategory(categories)
code_block = CodeBlock { 1..70..1; }
sum = Math.Sum(code_block)
code_block_2 = CodeBlock(x=code_block, sum1=sum) { x; sum1; Math.Round(x/sum1*255); 255 - Math.Round(x/sum1*255); }
code_block_3 = CodeBlock { 0; }
byARGB = Color.ByARGB(r=code_block_2.out2, g=code_block_2.out3, b=code_block_3)
overrideColorInView = Element.OverrideColorInView(element=all_elements_of_category, color=byARGB)
code_block_4 = CodeBlock(x=code_block) { x; x*100; }
readFromFile = Excel.ReadFromFile()
file_path = Filename("C:\Users\DSegraves\Documents\_Docs\Projects\BIM-Estimator\PEI_DAT_DB_ITEM.xlsx")
fromPath = FileObject(file_path)  # "File.FromPath"
code_block_5 = CodeBlock { "Sheet1"; }
readFromFile_2 = Excel.ReadFromFile(file=fromPath, sheetName=code_block_5)
string = StringInput("Cost")
setParameterByName = Element.SetParameterByName(element=all_elements_of_category, parameterName=string, value=code_block)
